# Grasshopper definition WoV Structure Script.gh (Grasshopper 1.0.7)
# plug-ins: Pufferfish, treesloth01

list = ValueList({"Reduce Trimmed Crvs": 0, "Original Trimmed Crvs": 1}, selected="Reduce Trimmed Crvs")

# ---- group: Core Parameters
cores_offset_from_center = Slider(25000, range=0..100000)
_2d_rotation = Slider(-110, range=-180..180)

# ---- group: Structure Division
facade_divisions = Slider(21, range=11..30)
beam_overlap = Slider(5, range=1..10)
inner_beams_reduce = Slider(10, range=1..20)

# ---- group: Core base Heights
# 3_ Structure 3D
trunk_01 = Slider(3000, range=0..10000)
trunk_02 = Slider(0, range=0..10000)
trunk_03 = Slider(6000, range=0..10000)

# ---- group: Beam Parameters
fillet = Slider(2500, range=0..5000)
depth = Slider(1500, range=100..3000)
width = Slider(250, range=100..500)

# ---- group: Core Parameters
# 2_Structure 2D
radius__core_1 = Slider(10000, range=0..15000)
radius__core_2 = Slider(10000, range=0..15000)
radius__core_3 = Slider(10000, range=0..20000)

# ---- group: Roof Geometry Parameters
roof__inclination = Slider(-3.7, range=-8..0)
# WoV
# structure script
# Hi! This is a simplified version of the script used to design the World of Volvo's main structure.
# It is meant for you to play, add features and test different methods.
# Feel free to reach out to me with comments or cool variations of the script -  I hope you enjoy.
# developed by Leonardo Castaman
# leca@henninglarsen.com
# 1_ Roof Geometry
roof__direction_of_inclination = Slider(0, range=-30..30)

roof__radius = Slider(50000, range=40000..100000)
facade_radius = Slider(43000, range=0..100000)
structure_height = Slider(20000, range=10000..50000)

# ---- group: Roof Geometry Parameters / Base Circle Rotation
x_axis = Slider(3.7, range=-5..5)
z_axis = Slider(-20, range=-90..90)

# ---- group: Center Point
pt = Point(Point(406220.6744, 252997.6952, 0))

# ----
cir = Circle(Plane=pt, Radius=facade_radius)

# ---- group: preparing section curves to be oriented / Section Curves
# Roof Geometry from Section Curves in Rhino Viewport
crv = Curve([<curve referenced from the Rhino model> x3])

# ---- group: Base Roof Geometry
Z = UnitZ(Factor=structure_height)
move = Move(Geometry=pt, Motion=Z)  # -> Geometry, Transform
cir_2 = Circle(Plane=move.Geometry, Radius=roof__radius)
xy = XYPlane(Origin=move.Geometry)
rotworld = RotateWorld(Geometry=cir_2, Plane=xy, Axis1=0, Axis2=1, Axis3=2, Degrees1=x_axis, Degrees2=0, Degrees3=z_axis)  # -> Rotated, Plane1, Plane2, Plane3, Transform
circle = Circle(rotworld.Rotated)

# ---- group: Boundary Crv
project = Project(Geometry=circle, Plane=pt)  # -> Geometry, Transform

# ---- group: Facade Crv
crv_2 = Curve(cir)

# ---- group: preparing section curves to be oriented
crv_3 = Curve(<curve referenced from the Rhino model>)
ccx = CurveCurve(CurveA=crv, CurveB=crv_3)  # -> Points, ParamsA, ParamsB
shatter = Shatter(Curve=graft(crv), Parameters=ccx.ParamsA)
item = ListItem(List=shatter, Index=0, Wrap=True)  # -> Item, Item1
flip = FlipCurve(Curve=item.Item)  # -> flatten(Curve), Flag
crv_4 = Curve(flatten(item.Item1))
shift = ShiftList(List=flip.Curve, Shift=-1, Wrap=True)
weave = Weave(Pattern=[0, 1], Stream0=crv_4, Stream1=shift, NullGaps=False)
crv_5 = Curve(reparameterize(weave))

# ---- group: Base Roof Geometry / Disc
boundary = BoundarySurfaces(Edges=circle)

# ---- group: Orientation of 2d pattern
rad = Radians(Degrees=_2d_rotation)
X = UnitX(Factor=1)
# 1. Creating base geometry for the structure linework
vrot = Rotate(Vector=X, Axis=Vector(0, 0, 1), Angle=rad)
line = LineSDL(Start=pt, Direction=vrot, Length=70000)

# ---- group: Divisions at Facade
# Adjusting seam so divisions are symetric
ccx_2 = CurveCurve(CurveA=line, CurveB=reparameterize(crv_2))  # -> Points, ParamsA, ParamsB
seam = Seam(Curve=reparameterize(crv_2), Seam=ccx_2.ParamsB)

# ---- group: Section Curve Planes
line_2 = Line(Line((535398.5841, 295997.3962, 0), (554525.0531, 244430.1762, 0)))
vec = Vector(line_2)

pt_2 = Point([<point referenced from the Rhino model> x3])
shift_2 = ShiftList(List=pt_2, Shift=-1, Wrap=True)
pl = ConstructPlane(Origin=shift_2, XAxis=expr("-x", vec), YAxis=Vector(0, 1, 0))
pl_2 = ConstructPlane(Origin=pt_2, XAxis=vec, YAxis=Vector(0, 1, 0))
weave_2 = Weave(Pattern=[0, 1], Stream0=pl_2, Stream1=pl, NullGaps=False)

# ---- group: Cross
rotate = Rotate(Geometry=line, Angle=expr("-x", degrees([0, 120, 240])), Plane=pt)  # -> Geometry, Transform
shift_3 = ShiftList(List=rotate.Geometry, Shift=-1, Wrap=True)
merge = Merge(Data1=simplify(graft(rotate.Geometry)), Data2=simplify(graft(shift_3)))
join = JoinCurves(Curves=merge, Preserve=False)

# ---- group: Cores / core center
rotate_2 = Rotate(Geometry=rotate.Geometry, Angle=degrees(60), Plane=pt)  # -> Geometry, Transform

# ----
weave_3 = Weave(Pattern=[0, 1], Stream0=rotate_2.Geometry, Stream1=rotate.Geometry, NullGaps=False)

# ---- group: Orientation Plans
evalsrf = EvaluateSurface(Surface=reparameterize(boundary), Point="0.5,0.5")  # -> Point, Normal, UDirection, VDirection, Frame
project_2 = Project(Curve=weave_3, Brep=boundary, Direction=Vector(0, 0, 1))  # -> flatten(Curve)
pl_3 = ConstructPlane(Origin=evalsrf.Point, XAxis=project_2, YAxis=evalsrf.Normal)

# ---- group: To
pln = Plane(pl_3)

# ---- group: From
pln_2 = Plane(weave_2)

# ---- group: Cores
cir_3 = Circle(Plane=pt, Radius=cores_offset_from_center)
ccx_3 = CurveCurve(CurveA=cir_3, CurveB=rotate_2.Geometry)  # -> flatten(Points), ParamsA, ParamsB
merge_2 = Merge(Data1=radius__core_1, Data2=radius__core_2, Data3=radius__core_3)
cir_4 = Circle(Plane=ccx_3.Points, Radius=merge_2)

# ---- group: Orienting Sections
xy_2 = XYPlane(Origin=Point(0, 0, 0))
len = Length(Curve=line_2)
round = Round(Number=len)  # -> Nearest, Floor, Ceiling
orient = Orient(Geometry=crv_5, Source=pln_2, Target=xy_2)  # -> Geometry, Transform
division = Division(A=roof__radius, B=round.Nearest)
scale_nu = ScaleNU(Geometry=orient.Geometry, Plane=xy_2, ScaleX=division, ScaleY=1, ScaleZ=1)  # -> Geometry, Transform
orient_2 = Orient(Geometry=scale_nu.Geometry, Source=xy_2, Target=pln)  # -> Geometry, Transform

# ----
# Roof Brep
loft = Loft(
    Curves=orient_2.Geometry,
    Options={Adjust=False, Closed=True, LoftEnds=0, LoftSimp=0, LoftType=5, Rebuild=10, Refit=0.01})

# ---- group: Surface
brep = Brep(loft)

# ---- group: Calculating angle to redistribute
# inner beams nr. minus amount of overlaping
expression = Expression(divisions=facade_divisions, order=beam_overlap, Expression="(2*divisions-1) - 2*(order-2)")

# ---- group: Divisions at Facade
panel = Panel(facade_divisions)
multiplication = Multiplication(A="3", B=panel)
panel_2 = Panel(multiplication)

# to get points offseted from start point
multiplication_2 = Multiplication(A=panel_2, B=2)
divide = DivideCurve(Curve=seam, Count=multiplication_2, Kinks=False)  # -> Points, Tangents, Parameters
dispatch = Dispatch(List=divide.Points, DispatchPattern=[True, False])  # -> ListA, ListB

shift_4 = ShiftList(List=dispatch.ListB, Shift=1, Wrap=True)

# ---- group: Divisions at Facade / organizing point list
# one list for each core projection,
# easier to manipulate list later
shift_5 = ShiftList(List=shift_4, Shift=expr("-x", panel), Wrap=True)
shift_6 = ShiftList(List=shift_4, Shift=panel, Wrap=True)
pt_3 = Point(shift_4)
entwine = Entwine(Branch00=pt_3, Branch01=shift_5, Branch02=shift_6, FlattenInputs=True)  # -> simplify(Result)

# ---- group: Projecting Points to Cross and Boundary
crv_6 = Curve(join)
pt_4 = Point(entwine)
crv_7 = Curve(cir_4)

crv_cp = CurveClosestPoint(Point=pt_4, Curve=simplify(graft(crv_7)))  # -> Point, Parameter, Distance
vec2pt = Vector2Pt(PointA=crv_cp.Point, PointB=pt_4, Unitize=False)  # -> Vector, Length
project_3 = ProjectPoint(Point=pt_4, Direction=vec2pt.Vector, Geometry=project.Geometry)  # -> Point, Index
ln = Line(StartPoint=simplify(crv_cp.Point), EndPoint=project_3.Point)  # -> simplify(Line)

# ---- group: Intersections at the cross
# 2. Creating structure linework / adding overlapping beams
ccx_4 = CurveCurve(CurveA=simplify(crv_6), CurveB=reparameterize(ln))  # -> simplify(Points), ParamsA, simplify(ParamsB)

# ---- group: beam planes
merge_3 = Merge(Data1=trunk_01, Data2=trunk_02, Data3=trunk_03)
Z_2 = UnitZ(Factor=merge_3)
Z_3 = UnitZ(Factor=1)
move_2 = Move(Geometry=pt, Motion=Z_2)  # -> simplify(graft(Geometry)), Transform

# ---- group: projecting curves to geometry
# Simplifyng crv
# so script is faster
panel_3 = Panel("5")

# ---- group: creating the overlapping beams
# modifying dispatch list to
# create overlaping beams
lng = ListLength(List=ccx_4.Points)
trim = TrimTree(Tree=lng, Depth=1)
listdexs = ListIndices(List=trim)
dispatch_2 = Dispatch(List=listdexs, DispatchPattern=trim)  # -> simplify(ListA), simplify(ListB)

# spliting map
expression_2 = Expression(x=beam_overlap, Expression="x*2")
lng_2 = ListLength(List=dispatch_2.ListA)
subtraction = Subtraction(A=lng_2, B=expression_2)
ins = InsertItems(List=subtraction, Item=beam_overlap, Indices=[0, -1], Wrap=True)  # -> simplify(List)

# ----
# Culling points at the cross
trim_2 = TrimTree(Tree=ccx_4.Points, Depth=1)
series = Series(Start=expr("-x", beam_overlap), Step=1, Count=expression_2)
cull_i = CullIndex(List=trim_2, Indices=series, Wrap=True)  # -> simplify(List)

# ---- group: creating the overlapping beams (continued)
partition = PartitionList(List=dispatch_2.ListA, Size=ins)
prune = PruneTree(Tree=partition, Minimum=0, Maximum=beam_overlap)
trim_3 = TrimTree(Tree=prune, Depth=1)
replace = ReplaceItems(List=trim, Item=0, Indices=trim_3, Wrap=False)  # -> simplify(List)

# ----
# Weaving pts at cross
# + pts at boundary
dispatch_3 = Dispatch(List=project_3.Point, DispatchPattern=replace)  # -> simplify(ListA), simplify(ListB)
weave_4 = Weave(Pattern=simplify(replace), Stream0=dispatch_3.ListB, Stream1=cull_i, NullGaps=False)
dispatch_4 = Dispatch(List=pt_4, DispatchPattern=replace)  # -> simplify(ListA), simplify(ListB)
pt_5 = Point(dispatch_4.ListB)

# ---- group: 2D Lines
ln_2 = Line(StartPoint=crv_cp.Point, EndPoint=weave_4)  # -> simplify(Line)

# ---- group: Extra Boundary Lines
ln_3 = Line(StartPoint=dispatch_3.ListA, EndPoint=dispatch_4.ListA)

# ----
lng_3 = ListLength(List=ln_3)  # -> flatten(Length)
item_2 = ListItem(List=lng_3, Index=0, Wrap=True)
panel_4 = Panel(item_2)
cross = Panel(beam_overlap)
expression_3 = Expression(x=panel_4, Expression="x/2")
expression_4 = Expression(x=cross, Expression="x-1")
subtraction_2 = Subtraction(A=expression_3, B=expression_4)
expression_5 = Expression(x=subtraction_2, Expression="x-1")
division_2 = Division(A=expression_5, B="2")
round_2 = Round(Number=division_2)  # -> Nearest, Floor, Ceiling
cross_2 = Panel(round_2.Floor)
subtraction_3 = Subtraction(A=item_2, B=cross_2)
merge_4 = Merge(Data1="0", Data2=subtraction_3)
series_2 = Series(Start=merge_4, Step=1, Count=cross_2)  # -> flatten(Series)
item_3 = ListItem(List=ln_3, Index=series_2, Wrap=True)

# ----
# 4. Adding Cross and Boundary beams
dispatch_5 = Dispatch(List=ln_2, DispatchPattern=replace)  # -> ListA, ListB
neg = Negative(Value=beam_overlap)
shift_7 = ShiftList(List=dispatch_5.ListB, Shift=neg, Wrap=True)  # -> simplify(List)
data = Data(dispatch_5.ListA)

# ---- group: Calculating angle to redistribute
# 3. Reducing number of inner curves
pt_6 = Point(pt_5)
shift_8 = ShiftList(List=pt_6, Shift=neg, Wrap=True)  # -> simplify(List)
item_4 = ListItem(List=shift_8, Index=0, Wrap=True)  # -> Item1, Item
pt_7 = Point(pt)
xy_3 = XYPlane(Origin=pt_7)
ln_4 = Line(StartPoint=pt_7, EndPoint=item_4.Item1)
ln_5 = Line(StartPoint=pt_7, EndPoint=item_4.Item)
angle = Angle(VectorA=ln_4, VectorB=ln_5, Plane=xy_3)  # -> Angle, Reflex

# measuring angle - facade divisions will be manipulated
deg = Degrees(Radians=angle.Angle)
item_5 = ListItem(List=flatten(deg), Index=0, Wrap=True)
multiplication_3 = Multiplication(A=item_5, B="100")
round_3 = Round(Number=multiplication_3)  # -> Nearest, Floor, Ceiling
division_3 = Division(A=round_3.Nearest, B="100")

# spaces between
# original curves
panel_5 = Panel(division_3)
panel_6 = Panel(expression)
division_4 = Division(A=panel_5, B=panel_6)

# ---- group: Remaining Divisions
subtraction_4 = Subtraction(A=panel_6, B=inner_beams_reduce)

# ---- group: Extra Angle to distribute
multiplication_4 = Multiplication(A=division_4, B=inner_beams_reduce)

# ---- group: Remaping extra angle
division_5 = Division(A="1", B=subtraction_4)
series_3 = Series(Start=0, Step=division_5, Count=expr("x+1", subtraction_4))
graph = GraphMapper(series_3, x0=0, x1=1, y0=0, y1=1, container_name="Sigmoid", e=0.07168357819, t0=-100, t1=100)
remap = RemapNumbers(Value=graph, Source=Domain(0, 1), Target=multiplication_4)  # -> Mapped, Clipped

# ----
# rotation angle for each beam
shift_9 = ShiftList(List=remap.Mapped, Shift=1, Wrap=True)
subtraction_5 = Subtraction(A=shift_9, B=remap.Mapped)
cull_i_2 = CullIndex(List=subtraction_5, Indices=-1, Wrap=True)
addition = Addition(A=division_4, B=cull_i_2)
ma = MassAddition(Input=addition)  # -> Result, PartialResults
rotate_3 = Rotate(Geometry=ln_4, Angle=degrees(ma.PartialResults), Plane=xy_3)  # -> simplify(Geometry), Transform

# ---- group: Creating new curves
cull_i_3 = CullIndex(List=rotate_3.Geometry, Indices=-1, Wrap=True)  # -> simplify(List)

# Points at facade
curvepoint = PointOnCurve(cull_i_3, parameter=1)

crv_cp_2 = CurveClosestPoint(Point=curvepoint, Curve=simplify(graft(crv_7)))  # -> Point, Parameter, Distance
vec2pt_2 = Vector2Pt(PointA=crv_cp_2.Point, PointB=curvepoint, Unitize=False)  # -> Vector, Length
project_4 = ProjectPoint(Point=crv_cp_2.Point, Direction=vec2pt_2.Vector, Geometry=crv_6)  # -> Point, Index
ln_6 = Line(StartPoint=crv_cp_2.Point, EndPoint=project_4.Point)
filter = StreamFilter(Gate=list, Stream0=ln_6, Stream1=data)

# ---- group: cross beam
item_6 = ListItem(List=shift_7, Index=0, Wrap=True)  # -> flatten(Item1), Item
shift_10 = ShiftList(List=item_6.Item1, Shift=1, Wrap=True)  # -> graft(List)
ccx_5 = CurveCurve(CurveA=reparameterize(shift_10), CurveB=reparameterize(item_6.Item))  # -> Points, ParamsA, ParamsB
ln_7 = Line(StartPoint=simplify(ccx_5.Points), EndPoint=pt)

# ----
# 2D Lines
merge_5 = Merge(Data1=shift_7, Data2=filter)
entwine_2 = Entwine(Branch00=ln_7, Branch01=item_3, FlattenInputs=True)  # -> simplify(Result)

# ---- group: Column + Beams
crv_8 = Curve(merge_5)

# ---- group: Column + Beam
# 1. Projecting curve to geometry
crv_9 = Curve(crv_8)

# ---- group: projecting curves to geometry (continued)
project_5 = Project(Curve=crv_9, Brep=brep, Direction=Vector(0, 0, 1))
trim_4 = TrimTree(Tree=simplify(project_5), Depth=1)
reb = RebuildCurve(Curve=trim_4, Degree=3, Count=panel_3, Tangents=True)  # -> simplify(Curve)

# ---- group: beam planes (continued)
curvepoint_2 = PointOnCurve(trim_4, parameter=0)
project_6 = Project(Geometry=curvepoint_2, Plane=move_2.Geometry)  # -> Geometry, Transform
pl_4 = ConstructPlane(Origin=project_6.Geometry, XAxis=crv_9, YAxis=Z_3)  # -> flatten(Plane)

# ---- group: Bottom Curve - Offset and fillet
offset = OffsetCurve(Curve=flatten(reb), Distance=depth, Plane=pl_4, Corners=0)  # -> flatten(Curve)
flatten = FlattenTree(Tree=crv_9, Path="{0}")
reb_2 = RebuildCurve(Curve=offset, Degree=3, Count=panel_3, Tangents=True)
amp = Amplitude(Vector=flatten, Amplitude=depth)
project_7 = Project(Geometry=reb_2, Plane=pl_4)  # -> Geometry, Transform
move_3 = Move(Geometry=flatten(project_6.Geometry), Motion=amp)  # -> Geometry, Transform
line_3 = LineSDL(Start=move_3.Geometry, Direction=Vector(0, 0, 1), Length=structure_height)
clx = CurveLine(Curve=project_7.Geometry, Line=line_3)  # -> flatten(Points), Params, Count
shatter_2 = Shatter(Curve=graft(project_7.Geometry), Parameters=clx.Params)
ln_8 = Line(StartPoint=move_3.Geometry, EndPoint=clx.Points)  # -> graft(Line)
item_7 = ListItem(List=shatter_2, Index="1", Wrap=True)
merge_6 = Merge(Data1=simplify(ln_8), Data2=simplify(item_7))
join_2 = JoinCurves(Curves=merge_6, Preserve=False)  # -> reparameterize(Curves)
fillet_2 = Fillet(Curve=join_2, Radius=fillet)  # -> flatten(Curve)

# ---- group: Top Curve
# 2. Creating Column + Beam Curves
ln_9 = Line(StartPoint=curvepoint_2, EndPoint=project_6.Geometry)
merge_7 = Merge(Data1=graft(ln_9), Data2=graft(reb))
join_3 = JoinCurves(Curves=merge_7, Preserve=False)  # -> simplify(flatten(Curves))
project_8 = Project(Geometry=join_3, Plane=pl_4)  # -> Geometry, Transform

# ---- group: Beams Outline
crv_10 = Curve(fillet_2)
# 3. Creating 3D Geometry
crv_11 = Curve(project_8.Geometry)
end = EndPoints(Curve=simplify(crv_10))  # -> Start, End
end_2 = EndPoints(Curve=simplify(crv_11))  # -> Start, End
ln_10 = Line(StartPoint=end.Start, EndPoint=end_2.End)
ln_11 = Line(StartPoint=end.End, EndPoint=end_2.Start)
entwine_3 = Entwine(Branch00=crv_10, Branch01=ln_10, Branch02=crv_11, Branch03=ln_11, FlattenInputs=True)
flip_2 = FlipMatrix(Data=entwine_3)
join_4 = JoinCurves(Curves=flip_2, Preserve=False)  # -> flatten(Curves)

# ---- group: Beams
crv_12 = Curve(entwine_2)

# ---- group: Beam
crv_13 = Curve(flatten(crv_12))

# ---- group: Cross + Boundary Beams Outline
curvepoint_3 = PointOnCurve(crv_13, parameter=0)
project_9 = Project(Curve=crv_13, Brep=brep, Direction=Vector(0, 0, 1))
reb_3 = RebuildCurve(Curve=project_9, Degree=3, Count=panel_3, Tangents=True)  # -> simplify(Curve)
pl_5 = ConstructPlane(Origin=curvepoint_3, XAxis=crv_13, YAxis=Z_3)
project_10 = Project(Geometry=flatten(reb_3), Plane=pl_5)  # -> Geometry, Transform
offset_2 = OffsetCurve(Curve=project_10.Geometry, Distance=depth, Plane=pl_5, Corners=1)  # -> flatten(Curve)
end_3 = EndPoints(Curve=project_10.Geometry)  # -> Start, End
end_4 = EndPoints(Curve=offset_2)  # -> Start, End
ln_12 = Line(StartPoint=end_3.Start, EndPoint=end_4.Start)
ln_13 = Line(StartPoint=end_3.End, EndPoint=end_4.End)
entwine_4 = Entwine(Branch00=project_10.Geometry, Branch01=ln_13, Branch02=offset_2, Branch03=ln_12, FlattenInputs=True)
flip_3 = FlipMatrix(Data=entwine_4)
join_5 = JoinCurves(Curves=flip_3, Preserve=False)  # -> flatten(Curves)

# ---- group: 3D Elements
unflatten = UnflattenTree(Tree=join_4, Guide=crv_8)
unflatten_2 = UnflattenTree(Tree=join_5, Guide=crv_12)
expression_6 = Expression(x=width, Expression="x/2")  # disabled
stack = StackTrees(Data0=unflatten, Data1=unflatten_2, Reduce=True)
neg_2 = Negative(Value=expression_6)  # disabled
offsrf = OffsetSurface(Surface=stack, Distance=expression_6, BothSides=neg_2, CreateSolid=True)  # disabled
trim_5 = TrimTree(Tree=offsrf, Depth=1)  # disabled

# ---- group: Beam Outlines
data_2 = Data(stack)

# ----
# 3D Geometry
group = Group(Objects=stack)  # -> flatten(Group)
group_2 = Group(Objects=trim_5)  # -> flatten(Group); disabled

# ---- group: 3D Structure
# Enable Components at the end of script First!
# Enable | Bake | Have fun
geo = Geometry(group_2)

# ----
stack_2 = StackTrees(Data0=crv_8, Data1=crv_12, Reduce=True)
# 1s faster rebuilding the curve!
group_3 = Group(Objects=stack_2)  # -> flatten(Group)

# ---- group: 2D Lines
# #Outputs
data_3 = Data(group_3)
